# Grasshopper definition VORONOI_DGB.gh (Grasshopper 1.0.8)

panel = Panel("\"C:\\MPDA\\MPDA_Session05_group_assignment\\testdavid2.py\"")
read_file = ReadFile(File=panel, PerLineParse=False)
point = Point([Point(56.52669882, -24.22508348, 0), Point(39.22629555, 10.21822233, 0), Point(59.34114246, 48.48775331, 0), Point(37.01990981, 83.21466275, 0), Point(48.96643341, 137.5370526, 0)])
interpolate = Interpolate(Vertices=point, Degree=3, Periodic=False, KnotStyle=1)  # -> Curve, Length, Domain
file_path = FilePath("voronoi_attractor.py")
curve_closest_point = CurveClosestPoint()  # -> Point, Parameter, Distance
curve = Curve(interpolate.Curve)
populate_geometry = PopulateGeometry(Count=100, Seed=1)
script = Script(
    width=Slider(70, range=0..100),
    depth=Slider(31, range=0..100),
    n_points=Slider(7, range=0..100),
    curve=curve,
    n_closest=Slider(24, range=0..100),
    domain_start=Slider(3, range=0..100),
    domain_end=Slider(70, range=0..100),
    offset_distance=Slider(0.68, range=0..1))  # -> out, a, b, c, d, e, f, g, h; inputs width: Double, depth: Double, n_points: Int32, curve: GeometryBase, n_closest: Int32, domain_start: Double, domain_end: Double, offset_distance: Double
# ---------- script: Python ----------
import Rhino.Geometry as rg
import rhinoscriptsyntax as rs
import ghpythonlib.components as gh

# ================================
# Inputs expected from Grasshopper
# ================================
width = globals().get('width', 10.0)
depth = globals().get('depth', 10.0)
n_points = globals().get('n_points', 25)
curve = globals().get('curve', None)
n_closest = globals().get('n_closest', 5)
domain_start = globals().get('domain_start', 0.2)
domain_end = globals().get('domain_end', 1.0)
offset_distance = globals().get('offset_distance', -0.1)
height = globals().get('height', 5.0)

# ================================
# Helper Functions (Nuestras herramientas personalizadas)
# ================================
def remap(value, source_domain, target_domain):
    src_min, src_max = source_domain
    dst_min, dst_max = target_domain
    if src_max == src_min: return dst_min
    t = (value - src_min) / float(src_max - src_min)
    return dst_min + t * (dst_max - dst_min)

def ensure_list(item):
    """
    Nuestro 'Organizador de Pallets'. 
    Asegura que cualquier objeto se convierta en una lista para poder iterar sobre él.
    """
    if item is None:
        return []
    # Si ya es una lista o tupla (un pallet), lo devuelve tal cual
    if isinstance(item, (list, tuple)):
        return item
    # Si es una geometría pura de Rhino (un solo ladrillo), lo envuelve en una lista [ ]
    if isinstance(item, rg.GeometryBase):
        return [item]
    # Si es otro tipo de colección de datos de C# (común en Grasshopper)
    if hasattr(item, '__iter__'):
        return list(item)
    # Si es cualquier otra cosa suelta, la envuelve
    return [item]

# ================================
# Main Script
# ================================

# 1. Create rectangular boundary 
plane = rg.Plane.WorldXY
rect_curve = rg.Rectangle3d(plane, width, depth).ToNurbsCurve()

# 2. Populate points
# Usamos ensure_list para garantizar que los puntos siempre sean una lista
raw_points = gh.PopulateGeometry(rect_curve, n_points, 1)
points = ensure_list(raw_points)

# 3. Generate 2D Voronoi cells
voronoi_result = gh.Voronoi(points, None, rect_curve, plane)

# Extraemos las celdas (el índice 0) y PASAMOS POR ensure_list ¡Aquí solucionamos tu error!
raw_cells = voronoi_result[0] if voronoi_result else []
voronoi_cells = ensure_list(raw_cells)

# 4. Calculate centroids using Grasshopper Area component
centroids = []
for cell in voronoi_cells: # ¡Esta línea ya no dará error!
    centroid = gh.Area(cell).centroid 
    centroids.append(centroid)

# 5. Verify curve input & Calculate Distances
closest_data = []
if curve and centroids:
    # 6. Find N closest centroids to the curve
    for idx, pt in enumerate(centroids):
        success, t = curve.ClosestPoint(pt)
        if success:
            closest_pt_on_curve = curve.PointAt(t)
            distance = pt.DistanceTo(closest_pt_on_curve)
            closest_data.append((distance, idx))
            
    # Ordenar por la distancia
    closest_data.sort(key=lambda item: item[0])

# Seleccionamos los índices de los elementos más cercanos
selected_indices = [item[1] for item in closest_data[:max(0, min(n_closest, len(closest_data)))]]

# 7. Cull pattern for selected Voronoi cells
selected_cells = [voronoi_cells[idx] for idx in selected_indices]
selected_centroids = [centroids[idx] for idx in selected_indices]
selected_distances = [closest_data[i][0] for i in range(len(selected_indices))] if closest_data else []

# 8. Remap distance values
remap_values = []
if selected_distances:
    source_domain = (min(selected_distances), max(selected_distances))
    target_domain = (domain_start, domain_end)
    remap_values = [remap(d, source_domain, target_domain) for d in selected_distances]

# 9. Scale, Offset, and Extrude
offset_surfaces = []
extrusions = []

for cell, centroid, scale_val, dist in zip(selected_cells, selected_centroids, remap_values, selected_distances):
    # Escalar
    scaled_result = gh.Scale(cell, centroid, scale_val)
    scaled_cell = scaled_result.geometry
    
    # Offset (Aseguramos que sea lista, porque OffsetCurve a veces devuelve varias curvas o una sola)
    offset_curves = ensure_list(gh.OffsetCurve(scaled_cell, offset_distance, plane, 1))
    
    if offset_curves:
        # Tomamos la primera curva del offset
        offset_cell = offset_curves[0] 
        
        # Crear Superficie
        surface = gh.BoundarySurfaces(offset_cell)
        offset_surfaces.append(surface)
        
        # Crear Vector y Extruir
        line_height = dist * height
        vector_up = rg.Vector3d(0, 0, line_height)
        
        extrusion = gh.Extrude(surface, vector_up)
        extrusions.append(extrusion)

# Outputs
a = voronoi_cells
b = centroids
c = selected_cells
d = offset_surfaces
e = extrusions
f = remap_values
# ---------- end script ----------
line_sdl = LineSDL(Direction=Vector(0, 0, 1), Length=1)
script_2 = Script(x=Slider(100, range=0..100), y=Slider(85, range=0..100), n=Slider(32, range=0..100))  # -> out, a, b; inputs x: Double, y: Double, n: Int32
# ---------- script_2: Python ----------
import Rhino.Geometry as rg
import ghpythonlib.components as gh

# 1. Crear el rectángulo base (nuestro dominio)
plano = rg.Plane.WorldXY
# El componente Rectangle en GH devuelve [Curva Rectángulo, Longitud]
# Usamos [0] para quedarnos solo con la curva.
rectangulo = gh.Rectangle(plano, x, y, 0)[0] 

# 2. Poblar el área con puntos aleatorios
# Usamos el equivalente al nodo 'Populate 2D'
puntos = gh.Populate2D(rectangulo, n)

# 3. Generar las celdas de Voronoi
# Le pasamos los puntos y usamos el rectángulo como límite (Boundary)
celdas = gh.Voronoi(puntos, boundary=rectangulo)

# 4. Calcular centroides
centroides = []
for celda in celdas:
    # El nodo Area devuelve [Valor del Área, Punto Centroide]
    datos_area = gh.Area(celda)
    
    # Queremos el centroide, que es el segundo elemento de la lista (índice 1)
    centroides.append(datos_area[1])

# Salidas (Outputs)
a = celdas
b = centroides
# ---------- end script_2 ----------
point_2 = Point(script_2.b)
geometry = Geometry(script_2.a)
panel_2 = Panel(script.out)
panel_3 = Panel(script_2.a)
panel_4 = Panel(script.a)
panel_5 = Panel(script.b)
panel_6 = Panel(script.c)
panel_7 = Panel(script.d)
panel_8 = Panel(script.h)
panel_9 = Panel(script.e)
panel_10 = Panel(script.g)
panel_11 = Panel(script.f)
panel_12 = Panel(script_2.b)
point_3 = Point([Point(56.52669882, -24.22508348, 0), Point(39.22629555, 10.21822233, 0), Point(59.34114246, 48.48775331, 0), Point(37.01990981, 83.21466275, 0), Point(48.96643341, 137.5370526, 0)])
read_file_2 = ReadFile(File="C:\MPDA\Session03\HOMEWORK\homework.py", PerLineParse=False)
interpolate_2 = Interpolate(Vertices=point_3, Degree=3, Periodic=False, KnotStyle=1)  # -> Curve, Length, Domain
read_file_3 = ReadFile(File="C:\MPDA\MPDA_Session05_group_assignment\testDav.py", PerLineParse=True)
panel_13 = Panel(read_file_2)
curve_2 = Curve(interpolate_2.Curve)
panel_14 = Panel(read_file_3)
script_3 = Script(
    script=read_file_3,
    width=Slider(13, range=0..100),
    depth=Slider(54, range=0..100),
    n_points=Slider(24, range=0..100),
    curve=curve_2,
    n_closest=Slider(3, range=0..100),
    domain_start=Slider(3, range=0..100),
    domain_end=Slider(6, range=0..100),
    offset_distance=Slider(0.47, range=0..1))  # -> out, a, b, c, d, e, f, g, h; inputs width: Double, depth: Double, n_points: Int32, curve: GeometryBase, n_closest: Int32, domain_start: Double, domain_end: Double, offset_distance: Double
#   port script: Script to execute
# ---------- script_3: Python ----------
import Rhino.Geometry as rg
import rhinoscriptsyntax as rs
import ghpythonlib.components as gh  # ¡El catálogo completo de nodos de Grasshopper!

# ================================
# Inputs expected from Grasshopper
# ================================
width = globals().get('width', 10.0)
depth = globals().get('depth', 10.0)
n_points = globals().get('n_points', 20)
curve = globals().get('curve', None)
n_closest = globals().get('n_closest', 5)
domain_start = globals().get('domain_start', 0.2)
domain_end = globals().get('domain_end', 1.0)
offset_distance = globals().get('offset_distance', -0.1)
height = globals().get('height', 5.0)

# Helper function
def remap(value, source_domain, target_domain):
    src_min, src_max = source_domain
    dst_min, dst_max = target_domain
    if src_max == src_min: return dst_min
    t = (value - src_min) / float(src_max - src_min)
    return dst_min + t * (dst_max - dst_min)

# 1. Create rectangular boundary (Usando geometría pura rg)
plane = rg.Plane.WorldXY
rect_curve = rg.Rectangle3d(plane, width, depth).ToNurbsCurve()

# 2. Populate points (Usando Grasshopper internamente)
# Sintaxis: gh.PopulateGeometry(Region, Count, Seed)
points = gh.PopulateGeometry(rect_curve, n_points, 1)

# 3. Generate 2D Voronoi cells
# Sintaxis: gh.Voronoi(Points, Radius, Boundary, Plane)
# Devuelve una tupla (Cells, Boundary). Tomamos el índice [0] para las celdas.
voronoi_result = gh.Voronoi(points, None, rect_curve, plane)
voronoi_cells = voronoi_result[0] if voronoi_result else []

# 4. Calculate centroids using Grasshopper Area component
centroids = []
for cell in voronoi_cells:
    # gh.Area devuelve (Area, Centroid). Pedimos la propiedad .centroid
    centroid = gh.Area(cell).centroid 
    centroids.append(centroid)

# 5. Verify curve input
closest_data = []
if curve and centroids:
    # 6. Find N closest centroids to the curve
    for idx, pt in enumerate(centroids):
        # rg.Curve.ClosestPoint nos da el punto más cercano en la curva
        success, t = curve.ClosestPoint(pt)
        if success:
            closest_pt_on_curve = curve.PointAt(t)
            distance = pt.DistanceTo(closest_pt_on_curve)
            closest_data.append((distance, idx))
            
    # Ordenar por distancia (el primer elemento de la tupla)
    closest_data.sort(key=lambda item: item[0])

selected_indices = [item[1] for item in closest_data[:max(0, min(n_closest, len(closest_data)))]]

# 7. Cull pattern for selected Voronoi cells
cull_pattern = [idx in selected_indices for idx in range(len(voronoi_cells))]
selected_cells = [voronoi_cells[idx] for idx in selected_indices]
selected_centroids = [centroids[idx] for idx in selected_indices]
selected_distances = [closest_data[i][0] for i in range(len(selected_indices))] if closest_data else []

# 8. Remap distance values
remap_values = []
if selected_distances:
    source_domain = (min(selected_distances), max(selected_distances))
    target_domain = (domain_start, domain_end)
    remap_values = [remap(d, source_domain, target_domain) for d in selected_distances]

# 9. Scale and Offset selected cells
offset_surfaces = []
extrude_lines = []
extrusions = []

for cell, centroid, scale_val, dist in zip(selected_cells, selected_centroids, remap_values, selected_distances):
    # Escalar usando Grasshopper Node
    scaled_result = gh.Scale(cell, centroid, scale_val)
    scaled_cell = scaled_result.geometry
    
    # Offset usando Grasshopper Node
    offset_cell = gh.OffsetCurve(scaled_cell, offset_distance, plane, 1)[0]
    
    if offset_cell:
        # Crear Superficie
        surface = gh.BoundarySurfaces(offset_cell)
        offset_surfaces.append(surface)
        
        # Crear Vector y Extruir
        line_height = dist * height
        vector_up = rg.Vector3d(0, 0, line_height)
        
        extrusion = gh.Extrude(surface, vector_up)
        extrusions.append(extrusion)

# Outputs
a = voronoi_cells
b = centroids
c = selected_cells
d = offset_surfaces
e = extrusions
f = remap_values
# ---------- end script_3 ----------
panel_15 = Panel(script_3.out)
python_3_script = Python3Script(script=read_file_2, x=Slider(100, range=0..100), y=Slider(100, range=0..100), h=Slider(47.2, range=0..100))  # -> a; inputs x: Double, y: Double, h: Double; unedited script template
panel_16 = Panel(script_3.h)
panel_17 = Panel(script_3.a)
panel_18 = Panel(script_3.b)
panel_19 = Panel(script_3.c)
panel_20 = Panel(script_3.d)
panel_21 = Panel(script_3.e)
panel_22 = Panel(script_3.g)
panel_23 = Panel(script_3.f)
panel_24 = Panel(python_3_script)
geometry_2 = Geometry(python_3_script)
mesh = Mesh(python_3_script)
deconstruct_mesh = DeconstructMesh(Mesh=mesh)  # -> Vertices, Faces, Colours, Normals
